# Dynamo custom node UI.Listview Data.dyf (Dynamo 1.2.1.3083)
# category: Data-Shapes.UI
# Create data for ListView input in UI.MultiInputForm ++ . Check out www.data-shapes.net for more infos.

InputName = Input(InputName : string = "Input")
Keys = Input()  # "Keys : []"
Values = Input()  # "Values : []"
Height = Input(Height : int = 200)
python_script = Python(IN[0]=InputName, IN[1]=Keys, IN[2]=Values, IN[3]=Height)
# ---------- python_script.python (47 lines) ----------
#Copyright (c) mostafa el ayoubi ,  2016
#Data-Shapes www.data-shapes.net , elayoubi.mostafa@gmail.com

class listview():

    def __init__(self,inputname,height):
        self.inputname = inputname
        self.height = height

    def __setitem__(self, key, item):
        self.__dict__[key] = item

    def __getitem__(self, key):
        return self.__dict__[key]

    def __iter__(self):
        return iter(self.__dict__)

    def values(self):
        return self.__dict__.values()

    def keys(self):
        return self.__dict__.keys()

    def __repr__(self):
        return 'UI.ListView input'
        
x = listview(IN[0],IN[3])

if isinstance(IN[1],list):
	in1 = IN[1]
else:
	in1 = [IN[1]]

if isinstance(IN[2],list):
	in2 = IN[2]
else:
	in2 = [IN[2]]

for k,v in zip(in1,in2):
	try:
		x[str(k)] = v
	except:
		x[k.encode('utf-8').decode('utf-8')] = v


OUT = x
# ----------------------------------------
ListView_input = Output(python_script)
